# Dynamo graph DEBUG_AcadSolids_1.dyn (Dynamo 2.12.1.8246)

acadApplicationVersions = DynAXDBLib.AcadApplication.AcadApplicationVersions()
acadApplication = DynAXDBLib.AcadApplication.AcadApplication(progID=acadApplicationVersions.AutoCAD_2023)
activeDocument = DynAXDBLib.AcadApplication.ActiveDocument(acadApplication=acadApplication)
selectEntities = DynAXDBLib.AcadEntity.SelectEntities(acadDocument=activeDocument)
acadSolid = DynAXDBLib.AcadSolid.AcadSolid(AcadEntity=selectEntities)
coordinates = DynAXDBLib.AcadSolid.Coordinates(acadSolid=acadSolid)
