# Dynamo graph Edit_polyline_coordinates.dyn (Dynamo 2.13.1.3887)
# packages: Link_COM_Acad 0.1.4, Link_COM_Acad 0.1.5

acadApplicationVersions = DynAXDBLib.AcadApplication.AcadApplicationVersions()
acadApplication = DynAXDBLib.AcadApplication.AcadApplication(progID=acadApplicationVersions.AutoCAD_2023)
activeDocument = DynAXDBLib.AcadApplication.ActiveDocument(acadApplication=acadApplication)
acadDatabase = DynAXDBLib.AcadDatabase.AcadDatabase(AcadDocument=activeDocument)
select_object = ObjectSelection()  # 1 picked in the model
code_block = CodeBlock(o=select_object) { o.Handle; }
string_from_object = FromObject(object=code_block)
handleToObject = DynAXDBLib.AcadDatabase.HandleToObject(acadDatabase=acadDatabase, Handle=string_from_object)
acadLWPolyline = DynAXDBLib.AcadLWPolyline.AcadLWPolyline(AcadEntity=handleToObject)
code_block_2 = CodeBlock { Point.ByCoordinates(1600, -700); 2; }
set_Coordinate = DynAXDBLib.AcadLWPolyline.Set_Coordinate(acadLWPolyline=acadLWPolyline, Index=code_block_2.out1, pVal=code_block_2.out0)
