# Dynamo graph Get polylines 2.dyn (Dynamo 2.13.1.3887)
# packages: Link_COM_Acad 0.0.1

acadApplicationVersions = DynAXDBLib.AcadApplication.AcadApplicationVersions()
acadApplication = DynAXDBLib.AcadApplication.AcadApplication(progID=acadApplicationVersions.AutoCAD_2023)
activeDocument = DynAXDBLib.AcadApplication.ActiveDocument(acadApplication=acadApplication)
fullName = DynAXDBLib.AcadDocument.FullName(acadDocument=activeDocument)
acadDatabase = DynAXDBLib.AcadDatabase.AcadDatabase(AcadDocument=activeDocument)
layers = DynAXDBLib.AcadDatabase.Layers(acadDatabase=acadDatabase)
getLayers = DynAXDBLib.AcadLayers.GetLayers(acadLayers=layers)
name = DynAXDBLib.AcadLayer.Name(acadLayer=getLayers)
modelSpace = DynAXDBLib.AcadDatabase.ModelSpace(acadDatabase=acadDatabase)
getAll = DynAXDBLib.AcadBlock.GetAll(acadBlock=modelSpace)
acadObject = DynAXDBLib.AcadObject.AcadObject(AnyModelObject=getAll)
objectName = DynAXDBLib.AcadObject.ObjectName(acadObject=acadObject)
code_block = CodeBlock { "AcDbPolyline"; }
eq = objectName == code_block
filterByBoolMask = List.FilterByBoolMask(list=getAll, mask=eq)
acadLWPolyline = DynAXDBLib.AcadLWPolyline.AcadLWPolyline(AcadEntity=filterByBoolMask.in)
coordinates = DynAXDBLib.AcadLWPolyline.Coordinates(acadLWPolyline=acadLWPolyline)
