# Dynamo graph Link_COM_Acad_MLeader_Actions.dyn (Dynamo 2.13.1.3887)
# packages: Link_COM_Acad 0.1.4, Link_COM_Acad 0.1.8, Link_COM_Acad 0.1.9

connectToAcadDoc = Custom[ConnectToAcadDoc]()  # package Link_COM_Acad; Getting an AcadDocument instance from current Civil 3D Dynamo document (node Document.Current)
acadDatabase = DynAXDBLib.AcadDatabase.AcadDatabase(AcadDocument=connectToAcadDoc)
select_object = ObjectSelection()  # 1 picked in the model
code_block = CodeBlock(o=select_object) { o.Handle; }
string_from_object = FromObject(object=code_block)
handleToObject = DynAXDBLib.AcadDatabase.HandleToObject(acadDatabase=acadDatabase, Handle=string_from_object)
acadMLeader = DynAXDBLib.AcadMLeader.AcadMLeader(AcadEntity=handleToObject)
styleName = DynAXDBLib.AcadMLeader.StyleName(acadMLeader=acadMLeader)
