# Dynamo graph Link_COM_Acad_SAMPLE_CreatePrimitiveObjects.dyn (Dynamo 2.13.1.3887)
# packages: Link_COM_Acad 0.1.6, Link_COM_Acad 0.1.7

connectToAcadDoc = Custom[ConnectToAcadDoc]()  # Getting an AcadDocument instance from current Civil 3D Dynamo document (nide Document.Current)

# group: Get Document instance
acadApplicationVersions = DynAXDBLib.AcadApplication.AcadApplicationVersions()
acadApplication = DynAXDBLib.AcadApplication.AcadApplication(progID=acadApplicationVersions.AutoCAD_2023)
activeDocument = DynAXDBLib.AcadApplication.ActiveDocument(acadApplication=acadApplication)
acadDatabase = DynAXDBLib.AcadDatabase.AcadDatabase(AcadDocument=connectToAcadDoc)
modelSpace = DynAXDBLib.AcadDatabase.ModelSpace(acadDatabase=acadDatabase)

# group: Create 3D-face with 3 and 3 vertices
coordinates_for_face_of_3_point = CodeBlock { Point.ByCoordinates(0,0,0); Point.ByCoordinates(3,0,0); Point.ByCoordinates(0,3,0); }
acad3DFace = DynAXDBLib.Acad3DFace.Acad3DFace(AcadBlock=modelSpace, Point1=coordinates_for_face_of_3_point.out0, Point2=coordinates_for_face_of_3_point.out1, Point3=coordinates_for_face_of_3_point.out2, Point4=coordinates_for_face_of_3_point.out2)
coordinates_for_face_of_4_point = CodeBlock { Point.ByCoordinates(0,0,0); Point.ByCoordinates(2,0,0); Point.ByCoordinates(2,2,0); Point.ByCoordinates(0,2,0); }
acad3DFace_2 = DynAXDBLib.Acad3DFace.Acad3DFace(AcadBlock=modelSpace, Point1=coordinates_for_face_of_4_point.out0, Point2=coordinates_for_face_of_4_point.out1, Point3=coordinates_for_face_of_4_point.out2, Point4=coordinates_for_face_of_4_point.out3)

# group: Create Arc
code_block = CodeBlock { [Point.ByCoordinates(2,2,0)]; 1; 0; }
acadArc = DynAXDBLib.AcadArc.AcadArc(AcadBlock=modelSpace, Center=code_block.out0, Radius=code_block.out1, StartAngle=code_block.out2, EndAngle=code_block.out1)

# group: Create Ellipse
code_block_2 = CodeBlock { Point.ByCoordinates(6,9, 0); Point.ByCoordinates(6,11, 0); 0.6; }
acadEllipse = DynAXDBLib.AcadEllipse.AcadEllipse(AcadBlock=modelSpace, Center=code_block_2.out0, MajorAxis=code_block_2.out1, RadiusRatio=code_block_2.out2)

# group: Create Polyline (getting only x\y from source coordinates)
code_block_3 = CodeBlock()
# ---------- code_block_3.designscript (6 lines) ----------
[Point.ByCoordinates(7,0),
Point.ByCoordinates(8,1),
Point.ByCoordinates(7,2,0),
Point.ByCoordinates(8,4)];
Point.ByCoordinates(7,5,0);
4;
# ----------------------------------------
acadLWPolyline = DynAXDBLib.AcadLWPolyline.AcadLWPolyline(AcadBlock=modelSpace, VerticesList=code_block_3.out0)
addVertex = DynAXDBLib.AcadLWPolyline.AddVertex(acadLWPolyline=acadLWPolyline, Index=code_block_3.out2, vertex=code_block_3.out1)

# group: Create Hatch definition
acHatchPatternTypePreDefined = Autodesk.AutoCAD.Interop.Common.AcPatternType.acHatchPatternTypePreDefined()
code_block_4 = CodeBlock { "SOLID"; true; }
acHatchObject = Autodesk.AutoCAD.Interop.Common.AcHatchObjectType.acHatchObject()
acadHatch = DynAXDBLib.AcadHatch.AcadHatch(AcadBlock=modelSpace, PatternType=acHatchPatternTypePreDefined, PatternName=code_block_4.out0, Associativity=code_block_4.out1, HatchObjectType=acHatchObject)

# group: Create Circle
blockref_creation = CodeBlock { [Point.ByCoordinates(6,6,0)]; 2.0; }
acadCircle = DynAXDBLib.AcadCircle.AcadCircle(AcadBlock=modelSpace, Center=blockref_creation.out0, Radius=blockref_creation.out1)

# group: Append to Hatch outer contour. Source countour MUST be closed (as exception 'Invalid input')
byAnyObject = DynAXDBLib.AcadEntity.ByAnyObject(AnyModelObject=acadCircle)
appendOuterLoop = DynAXDBLib.AcadHatch.AppendOuterLoop(acadHatch=acadHatch, ObjectArray=byAnyObject)
code_block_5 = CodeBlock(a=byAnyObject) { a; b = [a]; }

# group: Getting all Blocks names without ModelSpace and PaperSpace
blocks = DynAXDBLib.AcadDatabase.Blocks(acadDatabase=acadDatabase)
getObjects = DynAXDBLib.AcadBlocks.GetObjects(acadBlocks=blocks)
name = DynAXDBLib.AcadBlock.Name(acadBlock=getObjects)
code_block_6 = CodeBlock { "*"; }
contains = String.Contains(string=name, searchFor=code_block_6)
filterByBoolMask = List.FilterByBoolMask(list=name, mask=contains)

# group: Create BlockReference
blockref_creation_2 = CodeBlock(bl=filterByBoolMask.out) { bl[0]; [Point.ByCoordinates(2,4,0)]; 1.0; 0.0; }
acadBlockReference = DynAXDBLib.AcadBlockReference.AcadBlockReference(AcadBlock=modelSpace, InsertionPoint=blockref_creation_2.out1, Name=blockref_creation_2.out0, Xscale=blockref_creation_2.out2, Yscale=blockref_creation_2.out2, Zscale=blockref_creation_2.out2, Rotation=blockref_creation_2.out3)

# group: Create Leader with two variants: with and without Annotation object
code_block_7 = CodeBlock()
# ---------- code_block_7.designscript (4 lines) ----------
[Point.ByCoordinates(9,4, 0),
Point.ByCoordinates(12,8, 0),
Point.ByCoordinates(12,9, 0)];
0;
# ----------------------------------------
acLineWithArrow = Autodesk.AutoCAD.Interop.Common.AcLeaderType.acLineWithArrow()
byAnyObject_2 = DynAXDBLib.AcadEntity.ByAnyObject(AnyModelObject=acadBlockReference)
acadLeader = DynAXDBLib.AcadLeader.AcadLeader(AcadBlock=modelSpace, PointsArray=code_block_7.out0, Type=acLineWithArrow, Annotation=byAnyObject_2)
code_block_8 = CodeBlock()
# ---------- code_block_8.designscript (4 lines) ----------
[Point.ByCoordinates(10,4, 0),
Point.ByCoordinates(13,8, 0),
Point.ByCoordinates(13,9, 0)];
0;
# ----------------------------------------
acadLeader_2 = DynAXDBLib.AcadLeader.AcadLeader(AcadBlock=modelSpace, PointsArray=code_block_8.out0, Type=acLineWithArrow)

# group: Create Text and MText objects
code_block_9 = CodeBlock()
# ---------- code_block_9.designscript (8 lines) ----------
"Hello, Text!";

10;
Point.ByCoordinates(15,2,0);
Point.ByCoordinates(15,5,0);
0.1;
"Hello,
MText!";
# ----------------------------------------
acadMText = DynAXDBLib.AcadMText.AcadMText(AcadBlock=modelSpace, InsertionPoint=code_block_9.out3, Width=code_block_9.out1, Text=code_block_9.out5)
acadText = DynAXDBLib.AcadText.AcadText(AcadBlock=modelSpace, TextString=code_block_9.out0, InsertionPoint=code_block_9.out2, Height=code_block_9.out4)

# group: Create Spline (from list of 3d points)
code_block_10 = CodeBlock()
# ---------- code_block_10.designscript (6 lines) ----------
[Point.ByCoordinates(22,1,0),
Point.ByCoordinates(23,3,0),
Point.ByCoordinates(22,4,0),
Point.ByCoordinates(23,8,0)];
Vector.ByCoordinates(22,1,1);
Vector.ByCoordinates(23,10,0);
# ----------------------------------------
acadSpline = DynAXDBLib.AcadSpline.AcadSpline(AcadBlock=modelSpace, PointsArray=code_block_10.out0, StartTangent=code_block_10.out1, EndTangent=code_block_10.out2)

# group: As default, spline have FitPoints-mode; to update to Control point do that
acControlVertices = Autodesk.AutoCAD.Interop.Common.AcSplineMethodType.acControlVertices()
set_SplineMethod = DynAXDBLib.AcadSpline.Set_SplineMethod(acadSpline=acadSpline, method=acControlVertices)

# group: Create new Solid (non Solid3d)
code_block_11 = CodeBlock { Point.ByCoordinates(22,12,0); Point.ByCoordinates(21,14,2); Point.ByCoordinates(23,10,0); Point.ByCoordinates(22,11,3); }
acadSolid = DynAXDBLib.AcadSolid.AcadSolid(AcadBlock=modelSpace, Point1=code_block_11.out0, Point2=code_block_11.out1, Point3=code_block_11.out2, Point4=code_block_11.out3)

# group: Create Ray
code_block_12 = CodeBlock { Point.ByCoordinates(24,2,0); Point.ByCoordinates(24,4,0); 2.0; 15; "Shape 1"; }
acadRay = DynAXDBLib.AcadRay.AcadRay(AcadBlock=modelSpace, Point1=code_block_12.out0, Point2=code_block_12.out1)

# group: Create point and set variable PDMODE = 34
code_block_13 = CodeBlock { Point.ByCoordinates(24,8,0); }
acadPoint = DynAXDBLib.AcadPoint.AcadPoint(AcadBlock=modelSpace, Point=code_block_13)
code_block_14 = CodeBlock { "PDMODE 34  "; }
sendCommand = DynAXDBLib.AcadDocument.SendCommand(acadDocument=connectToAcadDoc, command=code_block_14)

# group: Create MLeader (the couple of points must multiple 3)
code_block_15 = CodeBlock()
# ---------- code_block_15.designscript (6 lines) ----------
[Point.ByCoordinates(25,4, 0),
Point.ByCoordinates(24,8, 0),
Point.ByCoordinates(24,9, 0),
Point.ByCoordinates(25,10, 0),
Point.ByCoordinates(25,12, 0),
Point.ByCoordinates(25,9, 0)];
# ----------------------------------------
acadMLeader = DynAXDBLib.AcadMLeader.AcadMLeader(AcadBlock=modelSpace, PointsArray=code_block_15)

# group: Create Line
code_block_16 = CodeBlock { Point.ByCoordinates(28, 0, 0); Point.ByCoordinates(27,10,10); }
acadLine = DynAXDBLib.AcadLine.AcadLine(AcadBlock=modelSpace, StartPoint=code_block_16.out0, EndPoint=code_block_16.out1)

# group: Create 2x2 PolygonMesh from 3x3 point's grid
code_block_17 = CodeBlock()
# ---------- code_block_17.designscript (10 lines) ----------
[Point.ByCoordinates(30,0,1),
Point.ByCoordinates(31,0,2),
Point.ByCoordinates(32,0,-2),
Point.ByCoordinates(30,1,5),
Point.ByCoordinates(31,1,3),
Point.ByCoordinates(32,1,2),
Point.ByCoordinates(30,2,4),
Point.ByCoordinates(31,2,0),
Point.ByCoordinates(32,2,1)];
3;
# ----------------------------------------
acadPolygonMesh = DynAXDBLib.AcadPolygonMesh.AcadPolygonMesh(AcadBlock=modelSpace, M=code_block_17.out1, N=code_block_17.out1, PointsMatrix=code_block_17.out0)
