# Dynamo graph Link_COM_Acad_SAMPLE_DocumentData.dyn (Dynamo 2.12.1.8246)

# group: Get Document instance
acadApplicationVersions = DynAXDBLib.AcadApplication.AcadApplicationVersions()
acadApplication = DynAXDBLib.AcadApplication.AcadApplication(progID=acadApplicationVersions.AutoCAD_2023)
activeDocument = DynAXDBLib.AcadApplication.ActiveDocument(acadApplication=acadApplication)
acadDatabase = DynAXDBLib.AcadDatabase.AcadDatabase(AcadDocument=activeDocument)
modelSpace = DynAXDBLib.AcadDatabase.ModelSpace(acadDatabase=acadDatabase)

limits = DynAXDBLib.AcadDatabase.Limits(acadDatabase=acadDatabase)
userCoordinateSystems = DynAXDBLib.AcadDatabase.UserCoordinateSystems(acadDatabase=acadDatabase)
getAcadUCS = DynAXDBLib.AcadUCSs.GetAcadUCS(acadUCSs=userCoordinateSystems)
name = DynAXDBLib.AcadUCS.Name(acadUCS=getAcadUCS)
origin = DynAXDBLib.AcadUCS.Origin(acadUCS=getAcadUCS)
summaryInfo = DynAXDBLib.AcadDatabase.SummaryInfo(acadDatabase=acadDatabase)
code_block = CodeBlock { "Some property"; "Some value"; }
addCustomInfo = DynAXDBLib.AcadSummaryInfo.AddCustomInfo(acadSummaryInfo=summaryInfo, key=code_block.out0, Value=code_block.out1)
plotConfigurations = DynAXDBLib.AcadDatabase.PlotConfigurations(acadDatabase=acadDatabase)
getAcadPlotConfigurations = DynAXDBLib.AcadPlotConfigurations.GetAcadPlotConfigurations(acadPlotConfigurations=plotConfigurations)
configName = DynAXDBLib.AcadPlotConfiguration.ConfigName(acadPlotConfiguration=getAcadPlotConfigurations)
name_2 = DynAXDBLib.AcadPlotConfiguration.Name(acadPlotConfiguration=getAcadPlotConfigurations)
