# Dynamo graph Link_COM_Acad_SAMPLE_Layouts.dyn (Dynamo 2.12.1.8246)

# group: Get Document instance
acadApplicationVersions = DynAXDBLib.AcadApplication.AcadApplicationVersions()
acadApplication = DynAXDBLib.AcadApplication.AcadApplication(progID=acadApplicationVersions.AutoCAD_2023)
activeDocument = DynAXDBLib.AcadApplication.ActiveDocument(acadApplication=acadApplication)
acadDatabase = DynAXDBLib.AcadDatabase.AcadDatabase(AcadDocument=activeDocument)
modelSpace = DynAXDBLib.AcadDatabase.ModelSpace(acadDatabase=acadDatabase)

layouts = DynAXDBLib.AcadDatabase.Layouts(acadDatabase=acadDatabase)
getLayouts = DynAXDBLib.AcadLayouts.GetLayouts(acadLayouts=layouts)
block = DynAXDBLib.AcadLayout.Block(acadLayout=getLayouts)
name = DynAXDBLib.AcadBlock.Name(acadBlock=block)
acadPlotConfiguration = DynAXDBLib.AcadPlotConfiguration.AcadPlotConfiguration(AcadLayout=getLayouts)
name_2 = DynAXDBLib.AcadPlotConfiguration.Name(acadPlotConfiguration=acadPlotConfiguration)
getObjects = DynAXDBLib.AcadBlock.GetObjects(acadBlock=block)
entityName = DynAXDBLib.AcadEntity.EntityName(acadEntity=getObjects)
