# Dynamo graph test1.dyn (Dynamo 2.17.3.4871)

acadApplication = DynAXDBLib.AcadApplication.AcadApplication()
acadDocument = DynAXDBLib.AcadDocument.AcadDocument(AcadApplication=acadApplication)
fullName = DynAXDBLib.AcadDocument.FullName(acadDocument=acadDocument)
