# Dynamo graph Сдвиг вершин.dyn (Dynamo 2.13.1.3887)
# packages: Link_COM_Acad 0.1.4, Link_COM_Acad 0.1.6

acadApplicationVersions = DynAXDBLib.AcadApplication.AcadApplicationVersions()
acadApplication = DynAXDBLib.AcadApplication.AcadApplication(progID=acadApplicationVersions.AutoCAD_2023)
activeDocument = DynAXDBLib.AcadApplication.ActiveDocument(acadApplication=acadApplication)
acadDatabase = DynAXDBLib.AcadDatabase.AcadDatabase(AcadDocument=activeDocument)
выбрать_грань_для_редактирования = ObjectSelection()  # 1 picked in the model; graph input
code_block = CodeBlock(o=выбрать_грань_для_редактирования) { o.Handle; }
string_from_object = FromObject(object=code_block)
handleToObject = DynAXDBLib.AcadDatabase.HandleToObject(acadDatabase=acadDatabase, Handle=string_from_object)
acad3DFace = DynAXDBLib.Acad3DFace.Acad3DFace(AcadEntity=handleToObject)
coordinates = DynAXDBLib.Acad3DFace.Coordinates(acad3DFace=acad3DFace)
грань_к_которой_необходимо = ObjectSelection()  # "Грань к которой необходимо сместить вершины"; 1 picked in the model; graph input
geometry = Autodesk.AutoCAD.DynamoNodes.Object.Geometry(object=грань_к_которой_необходимо)
surfaceGeometry = Face.SurfaceGeometry(face=geometry)
distanceTo = Geometry.DistanceTo(geometry=coordinates, other=surfaceGeometry)
code_block_2 = CodeBlock(a=distanceTo) { a<0.05; }
code_block_3 = CodeBlock { true; }
allIndicesOf = List.AllIndicesOf(list=code_block_2, item=code_block_3)
code_block_4 = CodeBlock(a=allIndicesOf) { a[0]; 0; }
filterByBoolMask = List.FilterByBoolMask(list=coordinates, mask=code_block_2)
closestPointTo = Geometry.ClosestPointTo(geometry=filterByBoolMask.in, other=surfaceGeometry)
code_block_5 = CodeBlock(a=closestPointTo) { a[0]; }
set_Coordinate = DynAXDBLib.Acad3DFace.Set_Coordinate(acad3DFace=acad3DFace, Index=code_block_4.out1, pVal=code_block_5)
