# Dynamo custom node ConnectAcadApp_2024.DYF (Dynamo 2.13.1.3887)
# category: Link_COM_Acad.DynAXDBLib.AcadApplication
# Connect (or start) to AutoCAD 2024
# packages: Link_COM_Acad 0.0.2

acadApplicationVersions = DynAXDBLib.AcadApplication.AcadApplicationVersions()
acadApplication = DynAXDBLib.AcadApplication.AcadApplication(progID=acadApplicationVersions.AutoCAD_2024)
activeDocument = DynAXDBLib.AcadApplication.ActiveDocument(acadApplication=acadApplication)
