# Dynamo custom node ConnectToAcadDoc.dyf (Dynamo 2.13.1.3887)
# category: Link_COM_Acad.DynAXDBLib.AcadDocument
# Getting an AcadDocument instance from current Civil 3D Dynamo document (node Document.Current)
# packages: Link_COM_Acad 0.1.7

current = Autodesk.AutoCAD.DynamoNodes.Document.Current()
documentextension = Python(IN[0]=current)  # "DocumentExtension.GetAcadDocument()"; IronPython2
# ---------- documentextension.python (20 lines) ----------
# Load the Python Standard and DesignScript Libraries
import sys
import clr

# Add Assemblies for AutoCAD
clr.AddReference('AcMgd')
clr.AddReference('AcDbMgd')

# Import references from AutoCAD
from Autodesk.AutoCAD.Runtime import *
from Autodesk.AutoCAD.ApplicationServices import *
from Autodesk.AutoCAD.DatabaseServices import *

# The inputs to this node will be stored as a list in the IN variables.
dataEnteringNode = IN

adoc = Application.DocumentManager.MdiActiveDocument
acad_doc = DocumentExtension.GetAcadDocument(adoc)

OUT = acad_doc
# ----------------------------------------
acadDocument = DynAXDBLib.AcadDocument.AcadDocument(AcadDocument_object=documentextension)
